# Grasshopper definition MeshLoad_tests.gh (Grasshopper 0.9.76)
# plug-ins: Karamba

nbeams = Panel("20")
nfaces = Panel("1500")
X = UnitX(Factor=1)
range = Range(Domain=Domain(0, 1), Steps=nbeams)
line = LineSDL(Start="0,0,0", Direction=X, Length="10")
Y = UnitY(Factor="0.5")
crv = Curve(line)
end = EndPoints(Curve=line)  # -> Start, End
shatter = Shatter(Curve=line, Parameters=range)
supp = SupportKaramba3D(PosInd=end.Start, menu=[buttons(on, on, on, on, on, on)])
neg = Negative(Value=Y)
linetobeam = LineToBeamKaramba3D(Line=shatter, New=True, Remove=True, LimitDistance_m=0.005)  # -> Element, Points, Info
move = Move(Geometry=crv, Motion=Y)  # -> Geometry, Transform
move_2 = Move(Geometry=crv, Motion=neg)  # -> Geometry, Transform
end_2 = EndPoints(Curve=move_2.Geometry)  # -> Start, End
end_3 = EndPoints(Curve=move.Geometry)  # -> Start, End
srf4pt = _4PointSurface(CornerA=end_3.Start, CornerB=end_3.End, CornerC=end_2.End, CornerD=end_2.Start)
mesh_uv = MeshSurface(Surface=srf4pt, UCount=nfaces, VCount="1", Overhang=True, Equalize=False)
Z = UnitZ(Factor="-1")
loads = LoadsKaramba3D(Vector=Z, Mesh=mesh_uv, LCase=0, mode="MeshLoad -Const.", menu=[buttons(off, on, off), buttons(on, on)])
assemble = AssembleModelKaramba3D(Elem=linetobeam.Element, Support=supp, Load=loads, LimitDistance_m=0.005)  # -> Model, Info, Mass_kg, CenterOfGravity
analyze = AnalyzeKaramba3D(Model=assemble.Model)  # -> CalculatedModel, MaximumDisplacement_cm, ResultingForceOfGravity_kN, ElasticEnergy_kNm
panel = Panel(analyze.MaximumDisplacement_cm)
